# Grasshopper definition 8-10 SPP Grasshopper Script.gh (Grasshopper 1.0.7)
# plug-ins: Weaverbird

pt = ConstructPoint(XCoordinate=Slider(0, range=0..10), YCoordinate=Slider(0, range=0..10), ZCoordinate=Slider(1.5, range=0..10))
pt_2 = ConstructPoint(XCoordinate=Slider(6, range=0..10), YCoordinate=Slider(0, range=0..10), ZCoordinate=Slider(1.5, range=0..10))
pt_3 = ConstructPoint(XCoordinate=Slider(0, range=0..10), YCoordinate=Slider(6, range=0..10), ZCoordinate=Slider(2, range=0..10))
pt_4 = ConstructPoint(XCoordinate=Slider(0, range=0..10), YCoordinate=Slider(0, range=0..10), ZCoordinate=Slider(2, range=0..10))
pt_5 = ConstructPoint(XCoordinate=Slider(0, range=0..10), YCoordinate=Slider(6, range=0..10), ZCoordinate=Slider(1.5, range=0..10))
pt_6 = ConstructPoint(XCoordinate=Slider(6, range=0..10), YCoordinate=Slider(6, range=0..10), ZCoordinate=Slider(1.5, range=0..10))
pt_7 = ConstructPoint(XCoordinate=Slider(6, range=0..10), YCoordinate=Slider(0, range=0..10), ZCoordinate=Slider(2, range=0..10))
pt_8 = ConstructPoint(XCoordinate=Slider(6, range=0..10), YCoordinate=Slider(6, range=0..10), ZCoordinate=Slider(2, range=0..10))
pt_9 = ConstructPoint(XCoordinate=Slider(0, range=0..10), YCoordinate=Slider(0, range=0..10), ZCoordinate=Slider(0, range=0..10))
pt_10 = ConstructPoint(XCoordinate=Slider(6, range=0..10), YCoordinate=Slider(0, range=0..10), ZCoordinate=Slider(0, range=0..10))
pt_11 = ConstructPoint(XCoordinate=Slider(6, range=0..10), YCoordinate=Slider(6, range=0..10), ZCoordinate=Slider(0, range=0..10))
pt_12 = ConstructPoint(XCoordinate=Slider(0, range=0..10), YCoordinate=Slider(6, range=0..10), ZCoordinate=Slider(0, range=0..10))
pt_13 = ConstructPoint(XCoordinate=Slider(0, range=0..10), YCoordinate=Slider(6, range=0..10), ZCoordinate=Slider(1, range=0..10))
pt_14 = ConstructPoint(XCoordinate=Slider(0, range=0..10), YCoordinate=Slider(0, range=0..10), ZCoordinate=Slider(6, range=0..10))
pt_15 = ConstructPoint(XCoordinate=Slider(6, range=0..10), YCoordinate=Slider(6, range=0..10), ZCoordinate=Slider(1, range=0..10))
pt_16 = ConstructPoint(XCoordinate=Slider(6, range=0..10), YCoordinate=Slider(0, range=0..10), ZCoordinate=Slider(6, range=0..10))
pt_17 = ConstructPoint(XCoordinate=Slider(0, range=0..10), YCoordinate=Slider(0, range=0..10), ZCoordinate=Slider(5.5, range=0..10))
pt_18 = ConstructPoint(XCoordinate=Slider(0, range=0..10), YCoordinate=Slider(6, range=0..10), ZCoordinate=Slider(4, range=0..10))
pt_19 = ConstructPoint(XCoordinate=Slider(6, range=0..10), YCoordinate=Slider(6, range=0..10), ZCoordinate=Slider(4, range=0..10))
pt_20 = ConstructPoint(XCoordinate=Slider(0, range=0..10), YCoordinate=Slider(0, range=0..10), ZCoordinate=Slider(1, range=0..10))
pt_21 = ConstructPoint(XCoordinate=Slider(6, range=0..10), YCoordinate=Slider(0, range=0..10), ZCoordinate=Slider(1, range=0..10))
pt_22 = ConstructPoint(XCoordinate=Slider(0, range=0..10), YCoordinate=Slider(6, range=0..10), ZCoordinate=Slider(6, range=0..10))
pt_23 = ConstructPoint(XCoordinate=Slider(6, range=0..10), YCoordinate=Slider(6, range=0..10), ZCoordinate=Slider(6, range=0..10))
pt_24 = ConstructPoint(XCoordinate=Slider(6, range=0..10), YCoordinate=Slider(0, range=0..10), ZCoordinate=Slider(5.5, range=0..10))
pt_25 = ConstructPoint(XCoordinate=Slider(0, range=0..10), YCoordinate=Slider(6, range=0..10), ZCoordinate=Slider(4.5, range=0..10))
pt_26 = ConstructPoint(XCoordinate=Slider(0, range=0..10), YCoordinate=Slider(0, range=0..10), ZCoordinate=Slider(4, range=0..10))
pt_27 = ConstructPoint(XCoordinate=Slider(6, range=0..10), YCoordinate=Slider(0, range=0..10), ZCoordinate=Slider(4, range=0..10))
pt_28 = ConstructPoint(XCoordinate=Slider(6, range=0..10), YCoordinate=Slider(6, range=0..10), ZCoordinate=Slider(4.5, range=0..10))
pt_29 = ConstructPoint(XCoordinate=Slider(6, range=0..10), YCoordinate=Slider(6, range=0..10), ZCoordinate=Slider(0.5, range=0..10))
pt_30 = ConstructPoint(XCoordinate=Slider(0, range=0..10), YCoordinate=Slider(6, range=0..10), ZCoordinate=Slider(5.5, range=0..10))
pt_31 = ConstructPoint(XCoordinate=Slider(6, range=0..10), YCoordinate=Slider(6, range=0..10), ZCoordinate=Slider(5.5, range=0..10))
pt_32 = ConstructPoint(XCoordinate=Slider(0, range=0..10), YCoordinate=Slider(0, range=0..10), ZCoordinate=Slider(0.5, range=0..10))
pt_33 = ConstructPoint(XCoordinate=Slider(0, range=0..10), YCoordinate=Slider(6, range=0..10), ZCoordinate=Slider(0.5, range=0..10))
pt_34 = ConstructPoint(XCoordinate=Slider(6, range=0..10), YCoordinate=Slider(0, range=0..10), ZCoordinate=Slider(0.5, range=0..10))
pt_35 = ConstructPoint(XCoordinate=Slider(0, range=0..10), YCoordinate=Slider(0, range=0..10), ZCoordinate=Slider(5, range=0..10))
pt_36 = ConstructPoint(XCoordinate=Slider(0, range=0..10), YCoordinate=Slider(6, range=0..10), ZCoordinate=Slider(5, range=0..10))
pt_37 = ConstructPoint(XCoordinate=Slider(6, range=0..10), YCoordinate=Slider(6, range=0..10), ZCoordinate=Slider(5, range=0..10))
pt_38 = ConstructPoint(XCoordinate=Slider(6, range=0..10), YCoordinate=Slider(0, range=0..10), ZCoordinate=Slider(5, range=0..10))
pt_39 = ConstructPoint(XCoordinate=Slider(0, range=0..10), YCoordinate=Slider(0, range=0..10), ZCoordinate=Slider(4.5, range=0..10))
pt_40 = ConstructPoint(XCoordinate=Slider(6, range=0..10), YCoordinate=Slider(0, range=0..10), ZCoordinate=Slider(4.5, range=0..10))

panel = Panel("Set initial geometry")
pt_41 = ConstructPoint(XCoordinate=Slider(6, range=0..20), YCoordinate=Slider(6, range=0..20), ZCoordinate=Slider(6, range=0..20))
pt_42 = ConstructPoint(XCoordinate=0, YCoordinate=0, ZCoordinate=0)
box = Box2Pt(PointA=pt_42, PointB=pt_41, Plane=PlaneXY(0, 0, 0))
geo = Geometry(box)

ln = Line(StartPoint=pt, EndPoint=pt_2)
ln_2 = Line(StartPoint=pt_12, EndPoint=pt_11)
ln_3 = Line(StartPoint=pt_5, EndPoint=pt_6)
ln_4 = Line(StartPoint=pt_4, EndPoint=pt_7)
ln_5 = Line(StartPoint=pt_13, EndPoint=pt_15)
ln_6 = Line(StartPoint=pt_3, EndPoint=pt_8)
ln_7 = Line(StartPoint=pt_17, EndPoint=pt_24)
ln_8 = Line(StartPoint=pt_22, EndPoint=pt_23)
ln_9 = Line(StartPoint=pt_20, EndPoint=pt_21)
ln_10 = Line(StartPoint=pt_32, EndPoint=pt_34)
ln_11 = Line(StartPoint=pt_18, EndPoint=pt_19)
ln_12 = Line(StartPoint=pt_33, EndPoint=pt_29)
ln_13 = Line(StartPoint=pt_25, EndPoint=pt_28)
ln_14 = Line(StartPoint=pt_9, EndPoint=pt_10)
ln_15 = Line(StartPoint=pt_30, EndPoint=pt_31)
ln_16 = Line(StartPoint=pt_35, EndPoint=pt_38)
ln_17 = Line(StartPoint=pt_39, EndPoint=pt_40)
ln_18 = Line(StartPoint=pt_14, EndPoint=pt_16)
ln_19 = Line(StartPoint=pt_26, EndPoint=pt_27)
ln_20 = Line(StartPoint=pt_36, EndPoint=pt_37)
crv = Curve(ln_3)
crv_2 = Curve(ln)
crv_3 = Curve(ln_5)
crv_4 = Curve(ln_8)
crv_5 = Curve(ln_6)
crv_6 = Curve(ln_17)
crv_7 = Curve(ln_13)
crv_8 = Curve(ln_9)
crv_9 = Curve(ln_4)
crv_10 = Curve(ln_11)
crv_11 = Curve(ln_12)
crv_12 = Curve(ln_16)
crv_13 = Curve(ln_10)
crv_14 = Curve(ln_18)
crv_15 = Curve(ln_15)
crv_16 = Curve(ln_19)
crv_17 = Curve(ln_7)
crv_18 = Curve(ln_20)
loft = Loft(
    Curves=reverse([crv_2, crv]),
    Options={Adjust=False, Closed=False, LoftEnds=0, LoftSimp=0, LoftType=0, Rebuild=10, Refit=0.01})
loft_2 = Loft(
    Curves=reverse([crv_8, crv_3]),
    Options={Adjust=False, Closed=False, LoftEnds=0, LoftSimp=0, LoftType=0, Rebuild=10, Refit=0.01})
loft_3 = Loft(
    Curves=reverse([crv_6, crv_7]),
    Options={Adjust=False, Closed=False, LoftEnds=0, LoftSimp=0, LoftType=0, Rebuild=10, Refit=0.01})
loft_4 = Loft(
    Curves=reverse([crv_9, crv_5]),
    Options={Adjust=False, Closed=False, LoftEnds=0, LoftSimp=0, LoftType=0, Rebuild=10, Refit=0.01})
loft_5 = Loft(Curves=[crv_14, crv_4], Options={Adjust=False, Closed=False, LoftEnds=0, LoftSimp=0, LoftType=0, Rebuild=10, Refit=0.01})
crv_19 = Curve(ln_14)
loft_6 = Loft(
    Curves=reverse([crv_16, crv_10]),
    Options={Adjust=False, Closed=False, LoftEnds=0, LoftSimp=0, LoftType=0, Rebuild=10, Refit=0.01})
crv_20 = Curve(ln_2)
loft_7 = Loft(
    Curves=reverse([crv_12, crv_18]),
    Options={Adjust=False, Closed=False, LoftEnds=0, LoftSimp=0, LoftType=0, Rebuild=10, Refit=0.01})
loft_8 = Loft(
    Curves=[crv_13, crv_11],
    Options={Adjust=False, Closed=False, LoftEnds=0, LoftSimp=0, LoftType=0, Rebuild=10, Refit=0.01})
loft_9 = Loft(
    Curves=[crv_17, crv_15],
    Options={Adjust=False, Closed=False, LoftEnds=0, LoftSimp=0, LoftType=0, Rebuild=10, Refit=0.01})
loft_10 = Loft(
    Curves=flatten([crv_20, crv_19]),
    Options={Adjust=False, Closed=False, LoftEnds=0, LoftSimp=0, LoftType=0, Rebuild=10, Refit=0.01})
popgeo = PopulateGeometry(Geometry=loft, Count=Slider(9, range=0..1000), Seed=1)
popgeo_2 = PopulateGeometry(Geometry=loft_2, Count=Slider(8, range=0..1000), Seed=1)
popgeo_3 = PopulateGeometry(Geometry=loft_5, Count=Slider(10, range=0..1000), Seed=1)
popgeo_4 = PopulateGeometry(Geometry=loft_6, Count=Slider(10, range=0..1000), Seed=1)
popgeo_5 = PopulateGeometry(Geometry=loft_3, Count=Slider(8, range=0..1000), Seed=1)
popgeo_6 = PopulateGeometry(Geometry=loft_4, Count=Slider(9, range=0..1000), Seed=1)
pop3d = Populate3D(Region=loft_8, Count=Slider(8, range=0..1000), Seed=1)
popgeo_7 = PopulateGeometry(Geometry=loft_7, Count=Slider(8, range=0..1000), Seed=1)
popgeo_8 = PopulateGeometry(Geometry=loft_9, Count=Slider(10, range=0..1000), Seed=1)
popgeo_9 = PopulateGeometry(Geometry=loft_10, Count=Slider(10, range=0..1000), Seed=1)

# ----
# Creates a 3D array of points based on number of points inputted, seed type, and region of point population (inputted geometry)
# Q: What does changing seed number do?
# Q: How to determine optimal number of points? Is this done iteratively based on volume of void and aspect ratio to match similarities of bone structure being studied?
# Enable for point array visualization and for poind details
number_slider = Slider(30, range=0..1000)
pop3d_2 = Populate3D(Region=geo, Count=number_slider, Seed=Slider(1, range=1..100))
points = PointList(Points=pop3d_2)
pt_43 = Point(pop3d_2)

# ----
# Centroid retrieval of inputted geometry
# Scaling object based on centroid and inputted geometry
volume = Volume(Geometry=geo)  # -> Volume, Centroid
scale = Scale(Geometry=geo, Center=volume.Centroid, Factor=Slider(1, range=0..1))  # -> Geometry, Transform

# ----
# Scaling object based on centroid and inputted geometry as well as a scaling factor
# Veronoi 3D Function - inputs 3D population of points and transforms them to closed breps (creating our interconnectiveness of cells)
# Deconstructing the breps into its constituent parts
# Deconstructing the breps into its constituent parts
# Scaling object based on centroid and inputted geometry as well as a scaling factor
# Breps (closed surfaces) to volume
# Deconstructing the breps into its constituent parts
voronoi³ = Voronoi3D(Points=[popgeo_9, pop3d_2, pop3d, popgeo_2, popgeo, popgeo_6, popgeo_3, popgeo_8, popgeo_5, popgeo_7, popgeo_4])  # -> Cells, Boundary
volume_2 = Volume(Geometry=voronoi³.Cells)  # -> Volume, graft(Centroid)
debrep = DeconstructBrep(Brep=voronoi³.Cells)  # -> Faces, Edges, Vertices
area = Area(Geometry=debrep.Faces)  # -> Area, Centroid
scale_2 = Scale(Geometry=debrep.Faces, Center=volume_2.Centroid, Factor=Slider(0.79, range=0..1))  # -> Geometry, Transform
scale_3 = Scale(Geometry=debrep.Faces, Center=area.Centroid, Factor=Slider(0.79, range=0..1))  # -> Geometry, Transform
debrep_2 = DeconstructBrep(Brep=scale_2.Geometry)  # -> Faces, Edges, Vertices
debrep_3 = DeconstructBrep(Brep=scale_3.Geometry)  # -> Faces, Edges, Vertices
geo_2 = Geometry(debrep_2.Edges)
geo_3 = Geometry(debrep_3.Edges)
end = EndPoints(Curve=geo_3)  # -> graft(Start), graft(End)
end_2 = EndPoints(Curve=geo_2)  # -> graft(Start), graft(End)
merge = Merge(Data1=end.Start, Data2=end.End, Data3=end_2.Start, Data4=end_2.End)
brepinc = PointInBrep(Brep=scale.Geometry, Point=merge, Strict=False)
ma = MassAddition(Input=brepinc)  # -> Result, PartialResults
quad = MeshQuad(
    CornerA=Slider(1, range=0..3),
    CornerB=Slider(3, range=0..3),
    CornerC=Slider(2, range=0..3),
    CornerD=Slider(0, range=0..3))
conmesh = ConstructMesh(Vertices=merge, Faces=quad)
equals = Equality(FirstNumber=ma.Result, SecondNumber=Slider(4, range=0..10))  # -> Equality, Inequality
cull = CullPattern(List=conmesh, CullPattern=equals.Equality)  # -> flatten(List)
# Final bake for object - shelled version
wbjoin = WeaverbirdsJoinMeshesAndWeld(Mesh=cull, Weld=False)
wbcatmullclark = WeaverbirdsCatmullClarkSubdivision(MeshCurves=wbjoin, Level=1, SmoothNakedEdges=1)

# ----
# More or less a black box with imported functions for tesselation and 3D structure development
cyl = Cylinder(Base=PlaneXY(0, 0, 0), Radius=0.5, Length=1)

# ----
# Scaling down the outer box region from the beginning of the process flow
# This gives the mesh of the intersection of the scaled down box and the porous structure; it's substracting the meshes from each other
# Bake this for your final lattice
# This is combining the substracted mesh and the cell structure to get one whole, closed mesh
# Quick fix for shell issue => cap the ends
# This is smoothing can be used for the final mesh; not really influencing it too much but it might be removing some sketchy edges
# Trimming the mesh lattice based on the capping; (1) is the output that we want (2) is the trim
geo_4 = Geometry(geo)
volume_3 = Volume(Geometry=geo_4)  # -> Volume, Centroid
scale_4 = Scale(Geometry=geo_4, Center=volume_3.Centroid, Factor=Slider(0.98, range=0..1))  # -> Geometry, Transform
mesh = Mesh(wbcatmullclark)
mesh_2 = MeshBrep(
    Brep=scale_4.Geometry,
    Settings={GridMaxCount=0, GridMinCount=16, JaggedSeams=False, MaxEdgeLength=0, MinEdgeLength=0.0001, MinTolerance=0, Refine=True, RefineAngle=0, RelativeTolerance=0.65, SimplePlanes=True, Tolerance=0})
msplit = MeshSplit(Mesh=mesh, Splitters=mesh_2)
panel_2 = Panel(msplit)
_1 = Number(1)
_0 = Number(0)
item = ListItem(List=msplit, Index=_1, Wrap=True)
mint = MeshIntersection(MeshesA=mesh_2, MeshesB=item)
item_2 = ListItem(List=msplit, Index=_0, Wrap=True)
merge_2 = Merge(Data1=mint, Data2=item)
mesh_3 = Mesh(merge_2)
mjoin = MeshJoin(Meshes=mesh_3)
mesh_4 = Mesh(mjoin)
msmooth = SmoothMesh(Mesh=mjoin, Strength=Slider(1, range=0..1), SkipNaked=True, Iterations=1)
