# Grasshopper definition Isotropic Grasshopper Script.gh (Grasshopper 1.0.7)
# plug-ins: Weaverbird

number_slider = Slider(0, range=0..10)  # disabled
number_slider_2 = Slider(0, range=0..10)  # disabled
number_slider_3 = Slider(0, range=0..10)  # disabled
number_slider_4 = Slider(0, range=0..10)  # disabled
number_slider_5 = Slider(1.5, range=0..10)  # disabled
number_slider_6 = Slider(6, range=0..10)  # disabled
number_slider_7 = Slider(0, range=0..10)  # disabled
number_slider_8 = Slider(1.5, range=0..10)  # disabled
number_slider_9 = Slider(0, range=0..10)  # disabled
number_slider_10 = Slider(0, range=0..10)  # disabled
number_slider_11 = Slider(0, range=0..10)  # disabled
number_slider_12 = Slider(6, range=0..10)  # disabled
number_slider_13 = Slider(0, range=0..10)  # disabled
number_slider_14 = Slider(2, range=0..10)  # disabled
number_slider_15 = Slider(2, range=0..10)  # disabled
number_slider_16 = Slider(6, range=0..10)  # disabled
number_slider_17 = Slider(0, range=0..10)  # disabled
number_slider_18 = Slider(0, range=0..10)  # disabled
number_slider_19 = Slider(5, range=0..10)  # disabled
number_slider_20 = Slider(6, range=0..10)  # disabled
number_slider_21 = Slider(0, range=0..10)  # disabled
number_slider_22 = Slider(1, range=0..10)  # disabled
number_slider_23 = Slider(1, range=0..10)  # disabled
number_slider_24 = Slider(1, range=0..10)  # disabled
number_slider_25 = Slider(6, range=0..10)  # disabled
number_slider_26 = Slider(0, range=0..10)  # disabled
number_slider_27 = Slider(0, range=0..10)  # disabled
number_slider_28 = Slider(0, range=0..10)  # disabled
number_slider_29 = Slider(0, range=0..10)  # disabled
number_slider_30 = Slider(6, range=0..10)  # disabled
number_slider_31 = Slider(2, range=0..10)  # disabled
number_slider_32 = Slider(6, range=0..10)  # disabled
number_slider_33 = Slider(1, range=0..10)  # disabled
number_slider_34 = Slider(0, range=0..10)  # disabled
number_slider_35 = Slider(6, range=0..10)  # disabled
number_slider_36 = Slider(6, range=0..10)  # disabled
number_slider_37 = Slider(6, range=0..10)  # disabled
number_slider_38 = Slider(6, range=0..10)  # disabled
number_slider_39 = Slider(0, range=0..10)  # disabled
number_slider_40 = Slider(6, range=0..10)  # disabled
number_slider_41 = Slider(1.5, range=0..10)  # disabled
number_slider_42 = Slider(6, range=0..10)  # disabled
number_slider_43 = Slider(2, range=0..10)  # disabled
number_slider_44 = Slider(0.5, range=0..10)  # disabled
number_slider_45 = Slider(0, range=0..10)  # disabled
number_slider_46 = Slider(0, range=0..10)  # disabled
number_slider_47 = Slider(6, range=0..10)  # disabled
number_slider_48 = Slider(5.5, range=0..10)  # disabled
number_slider_49 = Slider(6, range=0..10)  # disabled
number_slider_50 = Slider(6, range=0..10)  # disabled
number_slider_51 = Slider(5, range=0..10)  # disabled
number_slider_52 = Slider(6, range=0..10)  # disabled
number_slider_53 = Slider(6, range=0..10)  # disabled
number_slider_54 = Slider(6, range=0..10)  # disabled
number_slider_55 = Slider(0, range=0..10)  # disabled
number_slider_56 = Slider(6, range=0..10)  # disabled
number_slider_57 = Slider(0, range=0..10)  # disabled
number_slider_58 = Slider(6, range=0..10)  # disabled
number_slider_59 = Slider(1.5, range=0..10)  # disabled
number_slider_60 = Slider(0, range=0..10)  # disabled
number_slider_61 = Slider(6, range=0..10)  # disabled
number_slider_62 = Slider(6, range=0..10)  # disabled
number_slider_63 = Slider(6, range=0..10)  # disabled
number_slider_64 = Slider(6, range=0..10)  # disabled
number_slider_65 = Slider(6, range=0..10)  # disabled
number_slider_66 = Slider(0, range=0..10)  # disabled
number_slider_67 = Slider(6, range=0..10)  # disabled
number_slider_68 = Slider(0, range=0..10)  # disabled
number_slider_69 = Slider(0, range=0..10)  # disabled
number_slider_70 = Slider(0, range=0..10)  # disabled
number_slider_71 = Slider(0, range=0..10)  # disabled
number_slider_72 = Slider(6, range=0..10)  # disabled
number_slider_73 = Slider(0, range=0..10)  # disabled
number_slider_74 = Slider(0, range=0..10)  # disabled
number_slider_75 = Slider(6, range=0..10)  # disabled
number_slider_76 = Slider(5.5, range=0..10)  # disabled
number_slider_77 = Slider(0.5, range=0..10)  # disabled
number_slider_78 = Slider(0, range=0..10)  # disabled
number_slider_79 = Slider(6, range=0..10)  # disabled
number_slider_80 = Slider(6, range=0..10)  # disabled
number_slider_81 = Slider(0, range=0..10)  # disabled
number_slider_82 = Slider(4, range=0..10)  # disabled
number_slider_83 = Slider(4.5, range=0..10)  # disabled
number_slider_84 = Slider(4.5, range=0..10)  # disabled
number_slider_85 = Slider(4, range=0..10)  # disabled
number_slider_86 = Slider(6, range=0..10)  # disabled
number_slider_87 = Slider(4, range=0..10)  # disabled
number_slider_88 = Slider(0, range=0..10)  # disabled
number_slider_89 = Slider(6, range=0..10)  # disabled
number_slider_90 = Slider(6, range=0..10)  # disabled
number_slider_91 = Slider(0.5, range=0..10)  # disabled
number_slider_92 = Slider(0, range=0..10)  # disabled
number_slider_93 = Slider(0, range=0..10)  # disabled
number_slider_94 = Slider(6, range=0..10)  # disabled
number_slider_95 = Slider(0, range=0..10)  # disabled
number_slider_96 = Slider(0.5, range=0..10)  # disabled
number_slider_97 = Slider(6, range=0..10)  # disabled
number_slider_98 = Slider(6, range=0..10)  # disabled
number_slider_99 = Slider(0, range=0..10)  # disabled
number_slider_100 = Slider(6, range=0..10)  # disabled
number_slider_101 = Slider(6, range=0..10)  # disabled
number_slider_102 = Slider(4, range=0..10)  # disabled
number_slider_103 = Slider(5.5, range=0..10)  # disabled
number_slider_104 = Slider(5.5, range=0..10)  # disabled
number_slider_105 = Slider(0, range=0..10)  # disabled
number_slider_106 = Slider(6, range=0..10)  # disabled
number_slider_107 = Slider(6, range=0..10)  # disabled
number_slider_108 = Slider(6, range=0..10)  # disabled
number_slider_109 = Slider(5, range=0..10)  # disabled
number_slider_110 = Slider(0, range=0..10)  # disabled
number_slider_111 = Slider(6, range=0..10)  # disabled
number_slider_112 = Slider(0, range=0..10)  # disabled
number_slider_113 = Slider(5, range=0..10)  # disabled
number_slider_114 = Slider(0, range=0..10)  # disabled
number_slider_115 = Slider(0, range=0..10)  # disabled
number_slider_116 = Slider(0, range=0..10)  # disabled
number_slider_117 = Slider(4.5, range=0..10)  # disabled
number_slider_118 = Slider(6, range=0..10)  # disabled
number_slider_119 = Slider(0, range=0..10)  # disabled
number_slider_120 = Slider(4.5, range=0..10)  # disabled
pt = ConstructPoint(XCoordinate=number_slider_9, YCoordinate=number_slider_2, ZCoordinate=number_slider_5)  # disabled
pt_2 = ConstructPoint(XCoordinate=number_slider_6, YCoordinate=number_slider_7, ZCoordinate=number_slider_8)  # disabled
pt_3 = ConstructPoint(XCoordinate=number_slider_34, YCoordinate=number_slider_42, ZCoordinate=number_slider_31)  # disabled
pt_4 = ConstructPoint(XCoordinate=number_slider_11, YCoordinate=number_slider_13, ZCoordinate=number_slider_14)  # disabled
pt_5 = ConstructPoint(XCoordinate=number_slider_57, YCoordinate=number_slider_65, ZCoordinate=number_slider_59)  # disabled
pt_6 = ConstructPoint(XCoordinate=number_slider_56, YCoordinate=number_slider_53, ZCoordinate=number_slider_41)  # disabled
pt_7 = ConstructPoint(XCoordinate=number_slider_12, YCoordinate=number_slider_17, ZCoordinate=number_slider_15)  # disabled
pt_8 = ConstructPoint(XCoordinate=number_slider_35, YCoordinate=number_slider_47, ZCoordinate=number_slider_43)  # disabled
pt_9 = ConstructPoint(XCoordinate=number_slider, YCoordinate=number_slider_3, ZCoordinate=number_slider_4)  # disabled
pt_10 = ConstructPoint(XCoordinate=number_slider_20, YCoordinate=number_slider_21, ZCoordinate=number_slider_18)  # disabled
pt_11 = ConstructPoint(XCoordinate=number_slider_37, YCoordinate=number_slider_38, ZCoordinate=number_slider_27)  # disabled
pt_12 = ConstructPoint(XCoordinate=number_slider_10, YCoordinate=number_slider_25, ZCoordinate=number_slider_26)  # disabled
pt_13 = ConstructPoint(XCoordinate=number_slider_29, YCoordinate=number_slider_30, ZCoordinate=number_slider_24)  # disabled
pt_14 = ConstructPoint(XCoordinate=number_slider_60, YCoordinate=number_slider_69, ZCoordinate=number_slider_61)  # disabled
pt_15 = ConstructPoint(XCoordinate=number_slider_40, YCoordinate=number_slider_52, ZCoordinate=number_slider_33)  # disabled
pt_16 = ConstructPoint(XCoordinate=number_slider_62, YCoordinate=number_slider_66, ZCoordinate=number_slider_63)  # disabled
pt_17 = ConstructPoint(XCoordinate=number_slider_70, YCoordinate=number_slider_78, ZCoordinate=number_slider_76)  # disabled
pt_18 = ConstructPoint(XCoordinate=number_slider_71, YCoordinate=number_slider_94, ZCoordinate=number_slider_87)  # disabled
pt_19 = ConstructPoint(XCoordinate=number_slider_72, YCoordinate=number_slider_75, ZCoordinate=number_slider_82)  # disabled
pt_20 = ConstructPoint(XCoordinate=number_slider_45, YCoordinate=number_slider_46, ZCoordinate=number_slider_22)  # disabled
pt_21 = ConstructPoint(XCoordinate=number_slider_16, YCoordinate=number_slider_28, ZCoordinate=number_slider_23)  # disabled
pt_22 = ConstructPoint(XCoordinate=number_slider_92, YCoordinate=number_slider_97, ZCoordinate=number_slider_98)  # disabled
pt_23 = ConstructPoint(XCoordinate=number_slider_67, YCoordinate=number_slider_64, ZCoordinate=number_slider_58)  # disabled
pt_24 = ConstructPoint(XCoordinate=number_slider_54, YCoordinate=number_slider_55, ZCoordinate=number_slider_48)  # disabled
pt_25 = ConstructPoint(XCoordinate=number_slider_93, YCoordinate=number_slider_100, ZCoordinate=number_slider_83)  # disabled
pt_26 = ConstructPoint(XCoordinate=number_slider_81, YCoordinate=number_slider_74, ZCoordinate=number_slider_85)  # disabled
pt_27 = ConstructPoint(XCoordinate=number_slider_101, YCoordinate=number_slider_110, ZCoordinate=number_slider_102)  # disabled
pt_28 = ConstructPoint(XCoordinate=number_slider_79, YCoordinate=number_slider_80, ZCoordinate=number_slider_84)  # disabled
pt_29 = ConstructPoint(XCoordinate=number_slider_90, YCoordinate=number_slider_86, ZCoordinate=number_slider_91)  # disabled
pt_30 = ConstructPoint(XCoordinate=number_slider_105, YCoordinate=number_slider_106, ZCoordinate=number_slider_103)  # disabled
pt_31 = ConstructPoint(XCoordinate=number_slider_107, YCoordinate=number_slider_111, ZCoordinate=number_slider_104)  # disabled
pt_32 = ConstructPoint(XCoordinate=number_slider_88, YCoordinate=number_slider_95, ZCoordinate=number_slider_96)  # disabled
pt_33 = ConstructPoint(XCoordinate=number_slider_73, YCoordinate=number_slider_89, ZCoordinate=number_slider_77)  # disabled
pt_34 = ConstructPoint(XCoordinate=number_slider_32, YCoordinate=number_slider_39, ZCoordinate=number_slider_44)  # disabled
pt_35 = ConstructPoint(XCoordinate=number_slider_112, YCoordinate=number_slider_114, ZCoordinate=number_slider_113)  # disabled
pt_36 = ConstructPoint(XCoordinate=number_slider_68, YCoordinate=number_slider_49, ZCoordinate=number_slider_19)  # disabled
pt_37 = ConstructPoint(XCoordinate=number_slider_36, YCoordinate=number_slider_50, ZCoordinate=number_slider_51)  # disabled
pt_38 = ConstructPoint(XCoordinate=number_slider_108, YCoordinate=number_slider_99, ZCoordinate=number_slider_109)  # disabled
pt_39 = ConstructPoint(XCoordinate=number_slider_115, YCoordinate=number_slider_116, ZCoordinate=number_slider_117)  # disabled
pt_40 = ConstructPoint(XCoordinate=number_slider_118, YCoordinate=number_slider_119, ZCoordinate=number_slider_120)  # disabled

panel = Panel("Set initial geometry")
pt_41 = ConstructPoint(XCoordinate=Slider(6, range=0..20), YCoordinate=Slider(6, range=0..20), ZCoordinate=Slider(6, range=0..20))
pt_42 = ConstructPoint(XCoordinate=0, YCoordinate=0, ZCoordinate=0)
box = Box2Pt(PointA=pt_42, PointB=pt_41, Plane=PlaneXY(0, 0, 0))
geo = Geometry(box)

ln = Line(StartPoint=pt, EndPoint=pt_2)  # disabled
ln_2 = Line(StartPoint=pt_12, EndPoint=pt_11)  # disabled
ln_3 = Line(StartPoint=pt_5, EndPoint=pt_6)  # disabled
ln_4 = Line(StartPoint=pt_4, EndPoint=pt_7)  # disabled
ln_5 = Line(StartPoint=pt_13, EndPoint=pt_15)  # disabled
ln_6 = Line(StartPoint=pt_3, EndPoint=pt_8)  # disabled
ln_7 = Line(StartPoint=pt_17, EndPoint=pt_24)  # disabled
ln_8 = Line(StartPoint=pt_22, EndPoint=pt_23)  # disabled
ln_9 = Line(StartPoint=pt_20, EndPoint=pt_21)  # disabled
ln_10 = Line(StartPoint=pt_32, EndPoint=pt_34)  # disabled
ln_11 = Line(StartPoint=pt_18, EndPoint=pt_19)  # disabled
ln_12 = Line(StartPoint=pt_33, EndPoint=pt_29)  # disabled
ln_13 = Line(StartPoint=pt_25, EndPoint=pt_28)  # disabled
ln_14 = Line(StartPoint=pt_9, EndPoint=pt_10)  # disabled
ln_15 = Line(StartPoint=pt_30, EndPoint=pt_31)  # disabled
ln_16 = Line(StartPoint=pt_35, EndPoint=pt_38)  # disabled
ln_17 = Line(StartPoint=pt_39, EndPoint=pt_40)  # disabled
ln_18 = Line(StartPoint=pt_14, EndPoint=pt_16)  # disabled
ln_19 = Line(StartPoint=pt_26, EndPoint=pt_27)  # disabled
ln_20 = Line(StartPoint=pt_36, EndPoint=pt_37)  # disabled
crv = Curve(ln_3)  # disabled
crv_2 = Curve(ln)  # disabled
crv_3 = Curve(ln_5)  # disabled
number_slider_121 = Slider(11, range=0..1000)  # disabled
crv_4 = Curve(ln_8)  # disabled
crv_5 = Curve(ln_6)  # disabled
crv_6 = Curve(ln_17)  # disabled
crv_7 = Curve(ln_13)  # disabled
crv_8 = Curve(ln_9)  # disabled
crv_9 = Curve(ln_4)  # disabled
number_slider_122 = Slider(10, range=0..1000)  # disabled
crv_10 = Curve(ln_11)  # disabled
crv_11 = Curve(ln_12)  # disabled
crv_12 = Curve(ln_16)  # disabled
crv_13 = Curve(ln_10)  # disabled
crv_14 = Curve(ln_18)  # disabled
crv_15 = Curve(ln_15)  # disabled
number_slider_123 = Slider(12, range=0..1000)  # disabled
crv_16 = Curve(ln_19)  # disabled
number_slider_124 = Slider(11, range=0..1000)  # disabled
crv_17 = Curve(ln_7)  # disabled
number_slider_125 = Slider(10, range=0..1000)  # disabled
crv_18 = Curve(ln_20)  # disabled
number_slider_126 = Slider(10, range=0..1000)  # disabled
loft = Loft(Curves=[crv_2, crv], Options={Adjust=False, Closed=False, LoftEnds=0, LoftSimp=0, LoftType=0, Rebuild=10, Refit=0.01})  # disabled
number_slider_127 = Slider(10, range=0..1000)  # disabled
loft_2 = Loft(
    Curves=reverse([crv_8, crv_3]),
    Options={Adjust=False, Closed=False, LoftEnds=0, LoftSimp=0, LoftType=0, Rebuild=10, Refit=0.01})  # disabled
number_slider_128 = Slider(10, range=0..1000)  # disabled
loft_3 = Loft(
    Curves=reverse([crv_6, crv_7]),
    Options={Adjust=False, Closed=False, LoftEnds=0, LoftSimp=0, LoftType=0, Rebuild=10, Refit=0.01})  # disabled
loft_4 = Loft(
    Curves=reverse([crv_9, crv_5]),
    Options={Adjust=False, Closed=False, LoftEnds=0, LoftSimp=0, LoftType=0, Rebuild=10, Refit=0.01})  # disabled
loft_5 = Loft(Curves=[crv_14, crv_4], Options={Adjust=False, Closed=False, LoftEnds=0, LoftSimp=0, LoftType=0, Rebuild=10, Refit=0.01})  # disabled
crv_19 = Curve(ln_14)  # disabled
number_slider_129 = Slider(12, range=0..1000)  # disabled
crv_20 = Curve(ln_2)  # disabled
loft_6 = Loft(
    Curves=reverse([crv_17, crv_15]),
    Options={Adjust=False, Closed=False, LoftEnds=0, LoftSimp=0, LoftType=0, Rebuild=10, Refit=0.01})  # disabled
loft_7 = Loft(
    Curves=[crv_16, crv_10],
    Options={Adjust=False, Closed=False, LoftEnds=0, LoftSimp=0, LoftType=0, Rebuild=10, Refit=0.01})  # disabled
number_slider_130 = Slider(12, range=0..1000)  # disabled
loft_8 = Loft(
    Curves=[crv_13, crv_11],
    Options={Adjust=False, Closed=False, LoftEnds=0, LoftSimp=0, LoftType=0, Rebuild=10, Refit=0.01})  # disabled
loft_9 = Loft(
    Curves=[crv_12, crv_18],
    Options={Adjust=False, Closed=False, LoftEnds=0, LoftSimp=0, LoftType=0, Rebuild=10, Refit=0.01})  # disabled
loft_10 = Loft(
    Curves=reverse([crv_20, crv_19]),
    Options={Adjust=False, Closed=False, LoftEnds=0, LoftSimp=0, LoftType=0, Rebuild=10, Refit=0.01})  # disabled
popgeo = PopulateGeometry(Geometry=loft, Count=number_slider_121, Seed=1)  # disabled
popgeo_2 = PopulateGeometry(Geometry=loft_2, Count=number_slider_122, Seed=1)  # disabled
popgeo_3 = PopulateGeometry(Geometry=loft_5, Count=number_slider_123, Seed=1)  # disabled
popgeo_4 = PopulateGeometry(Geometry=loft_7, Count=number_slider_125, Seed=1)  # disabled
popgeo_5 = PopulateGeometry(Geometry=loft_3, Count=number_slider_126, Seed=1)  # disabled
popgeo_6 = PopulateGeometry(Geometry=loft_4, Count=number_slider_124, Seed=1)  # disabled
pop3d = Populate3D(Region=loft_8, Count=number_slider_127, Seed=1)  # disabled
popgeo_7 = PopulateGeometry(Geometry=loft_9, Count=number_slider_128, Seed=1)  # disabled
popgeo_8 = PopulateGeometry(Geometry=loft_6, Count=number_slider_130, Seed=1)  # disabled
popgeo_9 = PopulateGeometry(Geometry=loft_10, Count=number_slider_129, Seed=1)  # disabled

# ----
# Creates a 3D array of points based on number of points inputted, seed type, and region of point population (inputted geometry)
# Q: What does changing seed number do?
# Q: How to determine optimal number of points? Is this done iteratively based on volume of void and aspect ratio to match similarities of bone structure being studied?
# Enable for point array visualization and for poind details
number_slider_131 = Slider(123, range=0..1000)
pop3d_2 = Populate3D(Region=geo, Count=number_slider_131, Seed=Slider(1, range=1..100))
points = PointList(Points=pop3d_2)
pt_43 = Point(pop3d_2)

# ----
# Centroid retrieval of inputted geometry
# Scaling object based on centroid and inputted geometry
volume = Volume(Geometry=geo)  # -> Volume, Centroid
# More or less a black box with imported functions for tesselation and 3D structure development
scale = Scale(Geometry=geo, Center=volume.Centroid, Factor=Slider(1, range=0..1))  # -> Geometry, Transform

# ----
# Scaling object based on centroid and inputted geometry as well as a scaling factor
# Veronoi 3D Function - inputs 3D population of points and transforms them to closed breps (creating our interconnectiveness of cells)
# Deconstructing the breps into its constituent parts
# Deconstructing the breps into its constituent parts
# Scaling object based on centroid and inputted geometry as well as a scaling factor
# Breps (closed surfaces) to volume
# Deconstructing the breps into its constituent parts
voronoi³ = Voronoi3D(Points=[popgeo_9, pop3d_2, pop3d, popgeo_2, popgeo, popgeo_6, popgeo_3, popgeo_8, popgeo_5, popgeo_7, popgeo_4])  # -> Cells, Boundary
volume_2 = Volume(Geometry=voronoi³.Cells)  # -> Volume, graft(Centroid)
debrep = DeconstructBrep(Brep=voronoi³.Cells)  # -> Faces, Edges, Vertices
area = Area(Geometry=debrep.Faces)  # -> Area, Centroid
scale_2 = Scale(Geometry=debrep.Faces, Center=volume_2.Centroid, Factor=Slider(0.79, range=0..1))  # -> Geometry, Transform
scale_3 = Scale(Geometry=debrep.Faces, Center=area.Centroid, Factor=Slider(0.79, range=0..1))  # -> Geometry, Transform
debrep_2 = DeconstructBrep(Brep=scale_2.Geometry)  # -> Faces, Edges, Vertices
debrep_3 = DeconstructBrep(Brep=scale_3.Geometry)  # -> Faces, Edges, Vertices
geo_2 = Geometry(debrep_2.Edges)
geo_3 = Geometry(debrep_3.Edges)
end = EndPoints(Curve=geo_3)  # -> graft(Start), graft(End)
end_2 = EndPoints(Curve=geo_2)  # -> graft(Start), graft(End)
merge = Merge(Data1=end.Start, Data2=end.End, Data3=end_2.Start, Data4=end_2.End)
brepinc = PointInBrep(Brep=scale.Geometry, Point=merge, Strict=False)
ma = MassAddition(Input=brepinc)  # -> Result, PartialResults
quad = MeshQuad(
    CornerA=Slider(1, range=0..3),
    CornerB=Slider(3, range=0..3),
    CornerC=Slider(2, range=0..3),
    CornerD=Slider(0, range=0..3))
conmesh = ConstructMesh(Vertices=merge, Faces=quad)
equals = Equality(FirstNumber=ma.Result, SecondNumber=Slider(4, range=0..10))  # -> Equality, Inequality
cull = CullPattern(List=conmesh, CullPattern=equals.Equality)  # -> flatten(List)
# Final bake for object - shelled version
wbjoin = WeaverbirdsJoinMeshesAndWeld(Mesh=cull, Weld=False)
wbcatmullclark = WeaverbirdsCatmullClarkSubdivision(MeshCurves=wbjoin, Level=1, SmoothNakedEdges=1)

# ----
# Scaling down the outer box region from the beginning of the process flow
# This gives the mesh of the intersection of the scaled down box and the porous structure; it's substracting the meshes from each other
# Bake this for your final lattice
# This is combining the substracted mesh and the cell structure to get one whole, closed mesh
# Quick fix for shell issue => cap the ends
# This is smoothing can be used for the final mesh; not really influencing it too much but it might be removing some sketchy edges
# Trimming the mesh lattice based on the capping; (1) is the output that we want (2) is the trim
geo_4 = Geometry(geo)
volume_3 = Volume(Geometry=geo_4)  # -> Volume, Centroid
scale_4 = Scale(Geometry=geo_4, Center=volume_3.Centroid, Factor=Slider(0.976, range=0..1))  # -> Geometry, Transform
mesh = Mesh(wbcatmullclark)
mesh_2 = MeshBrep(
    Brep=scale_4.Geometry,
    Settings={GridMaxCount=0, GridMinCount=16, JaggedSeams=False, MaxEdgeLength=0, MinEdgeLength=0.0001, MinTolerance=0, Refine=True, RefineAngle=0, RelativeTolerance=0.65, SimplePlanes=True, Tolerance=0})
msplit = MeshSplit(Mesh=mesh, Splitters=mesh_2)
panel_2 = Panel(msplit)
_1 = Number(1)
_0 = Number(0)
item = ListItem(List=msplit, Index=_1, Wrap=True)
mint = MeshIntersection(MeshesA=mesh_2, MeshesB=item)
item_2 = ListItem(List=msplit, Index=_0, Wrap=True)
merge_2 = Merge(Data1=mint, Data2=item)
mesh_3 = Mesh(merge_2)
mjoin = MeshJoin(Meshes=mesh_3)
msmooth = SmoothMesh(Mesh=mjoin, Strength=Slider(1, range=0..1), SkipNaked=True, Iterations=1)

mesh_4 = Mesh(mjoin)
